% Simulink data dictionary FideltypathFollowingData.sldd

rawSensorDataBus = Simulink.Bus(DataScope="Imported", HeaderFile="interfaceDefinition.h")
  Euler_raw: int16[3]
  Ab_raw: int16[3]
  G_raw: int16[3]
  q_raw: uint16
  static_raw: uint16
  T_raw: int16
  ctrlSurface_PWM: int16[5]

gpsReading = Simulink.Bus(DataScope="Imported", HeaderFile="interfaceDefinition.h")  % Generic structure to hold a GPS reading
  gps_latLon: single[2], Unit="deg"
  gps_h: single, Unit="m"
  gps_cog: single, Unit="deg"
  gps_sog: single, Unit="m/s"
  gps_fix: uint8

ctrlCmdsBus = Simulink.Bus(DataScope="Imported", HeaderFile="interfaceDefinition.h")  % This bus holds the control commnads sent by the Autopilo to the actuators.
  elevatorCmd: single, Unit="rad"  % Elevator command in radians.
  throttleCmd: single, Unit="%"  % Aileron command in percent 0 -100.
  aileronCmd: single, Unit="rad"  % Aileron command in radians.
  rudderCmd: single, Unit="rad"  % Rudder command in radians.
  flapCmd: single, Unit="rad"  % Flap command in radians.

environmentDataBus = Simulink.Bus()  % This bus holds the data fron the Environment Model for simulation
  windVelocities: double[3], Unit="m/s"
  windAngularRates: double[3], Unit="rad/s"
  localGravity: double[3], Unit="m/s^2"
  atmosphere: Bus: atmosphericDataBus

uavStateBus = Simulink.Bus()
  Euler: double[3], Unit="rad"  % Euler rotation angles [roll, pitch, yaw], in radians.
  pqr: double[3], Unit="rad/s"  % angular rates in body-fixed axes, in radians per second.
  X_e: double[3], Unit="m"  % position in the flat Earth reference frame.
  V_e: double[3], Unit="m/s"  % velocity in the flat Earth reference frame.
  A_b: double[3], Unit="m/s^2"  % accelerations in body-fixed axes.
  baro: double, Unit="Pa"
  q: double, Unit="Pa"
  OAT: double, Unit="degree_Celsius"
  airspeed: double, Unit="m/s"
  gps_latLon: double[2], Unit="deg"
  gps_h: double, Unit="m"
  gps_cog: double, Unit="deg"
  gps_sog: double, Unit="m/s"
  gps_fix: double
  ctrlSurfacePos: double[5]

Zpoints = [230 250 220 230 230 210 220 230 230]
Ypoints = [850 275 275 0 0 850 850 850 850]
Xpoints = [375 375 100 100 550 550 375 375 375]
simMode = 0

sensors = struct(
  noiseOn=0,
  max_euler=6.283185,
  max_accel=4,
  bit_scale=32768,
  max_gyro=4,
  max_temp=150,
  max_dyn=1800,
  gpsRefreshRate=0.2,
  max_ctrlSrfc=1.570796,
  antialiasBW=40)

QGC = 0
hasSF = 1
GPSTimeSeed = [2018 1 26 10 20 18]

midLevelControlBus = Simulink.Bus()
  h_c: single
  U_c: single
  phi_c: single

apStatusBus = Simulink.Bus()
  Ab: single[3], Unit="m/s^2"
  G: single[3], Unit="rad/s"
  Euler: single[3], Unit="rad"
  ias: single, Unit="m/s"
  baro: single, Unit="Pa"
  Xe: single[3], Unit="m"
  Ve: single[3], Unit="m/s"
  GPS: Bus: gpsReading

FixedWingEnvironmentBus = Simulink.Bus()
  WindNorth: double
  WindEast: double
  WindDown: double
  Gravity: double

ap = struct(
  apSampleTime=0.01,
  baro=struct(lapseRate=-0.00198122),
  cf=struct(zCutoff=0.2, xCutoff=4, yCutoff=4, baroCutoff=0.06047888, accBiasRateLimit=9.89e-7, vzCutoff=2),
  guidance=struct(
    maxEta=single(0.71451813),
    maxAcc=single(4.5729),
    maxDwnPthStar=single(1),
    tanIntercept=single(0.5774),
    IPStar=single(0.6),
    tstar=single(3.5),
    turnLeadTime=single(5.5)),
  control=struct(
    derivativesConstant=5,
    dtLimit=single(0.95),
    deLimit=single(0.401425719),
    the_cLimit=single(0.261799395),
    daLimit=single(0.52359879),
    drLimit=single(0.17453292),
    phi_cLimit=single(0.610865235)))

env = struct(
  ISA_lapse=0.0065,
  ISA_hmax=2000,
  ISA_R=287.0531,
  ISA_g=9.80665,
  ISA_rho0=1.225,
  ISA_P0=101325,
  ISA_T0=288.15,
  windBase=12,
  windDirTurb=180,
  windDirHor=90,
  windOn=0)

apConfigParamsBus = Simulink.Bus(DataScope="Imported", HeaderFile="interfaceDefinition.h")  % This bus holds all the configuration parameters for the autopilot
  airspeedHoldPID: single[3]
  dEFeedForward: single
  he2ThPID: single[3]
  th2dTPID: single[3]
  dTFeedForward: single
  rollControlPID: single[3]
  yawDamperPID: single[3]

FixedWingStateBus = Simulink.Bus()
  North: double
  East: double
  Height: double
  AirSpeed: double
  HeadingAngle: double
  FlightPathAngle: double
  RollAngle: double
  RollAngleRate: double

FixedWingControlBus = Simulink.Bus()
  Height: double
  AirSpeed: double
  RollAngle: double

plantConfigSet = Simulink.ConfigSet(StartTime="0", StopTime="TFinal", RelTol="1e-3", Solver="VariableStepAuto", ProdHWDeviceType="Generic->32-bit x86 compatible", SystemTargetFile="grt.tlc", TargetLang="C")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
useHighFidelity = 1
TFinal = 150

uavParam = struct(
  geometry=struct(span=2.795, chord=0.3513417, S=0.982, elarm=1.21, mass=8.164663),
  inertia=struct(Ixx=4.12, Iyy=9.58, Izz=9.85),
  aero=struct(
    CL0=0.38,
    CLa=18.5,
    CLa_dot=2.64,
    CLq=7.4,
    CLDe=0.24,
    CLDf=0.4,
    CD0=0.022,
    A1=0.007,
    Apolar=0.057,
    CYb=-1.098,
    CYDr=0.143,
    Clb=-0.296,
    Clp=-1.96,
    Clr=0.103,
    ClDa=0.1695,
    ClDr=0.106,
    Cm0=0.3,
    Cma=-1.239,
    Cma_dot=-7,
    Cmq=-2.4,
    CmDe=-3.2,
    CmDf=-0.021,
    Cnb=0.277,
    Cnp=-0.0889,
    Cnr=-0.19997,
    CnDa=-0.023,
    CnDr=-0.1997),
  engine=struct(MinThK=0.077, ThK=2.17, TFact=0.2),
  ic=struct(
    Pos_0=[0; 0; 50],
    Euler_0=[0; 0; 0],
    Omega_0=[0; 0; 0],
    PQR_0=[0; 0; 0],
    Vb_0=[18; 0; 0],
    gsLL=[42.2996388 -71.3517757],
    gsH=0),
  sampleTime=0.005)

apStatusBusCopy = Simulink.Bus()
  Ab: double[3], Unit="m/s^2"
  G: double[3], Unit="rad/s"
  Euler: double[3], Unit="rad"
  ias: double, Unit="m/s"
  baro: double, Unit="Pa"
  Xe: double[3], Unit="m"
  Ve: double[3], Unit="m/s"
  GPS: Bus: gpsReadingCopy

gpsReadingCopy = Simulink.Bus(DataScope="Imported", HeaderFile="interfaceDefinition.h")  % Generic structure to hold a GPS reading
  gps_latLon: double[2], Unit="deg"
  gps_h: double, Unit="m"
  gps_cog: double, Unit="deg"
  gps_sog: double, Unit="m/s"
  gps_fix: uint8

ctrlConfigSet = Simulink.ConfigSet(StartTime="0", StopTime="TFinal", RelTol="1e-4", Solver="VariableStepAuto", ProdHWDeviceType="Generic->Unspecified (assume 32-bit Generic)", SystemTargetFile="grt.tlc", TargetLang="C")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