% Simulink data dictionary stepFideltyResponseData.sldd
% references FideltypathFollowingData.sldd

MultirotorGuidanceStateBus = Simulink.Bus()
  WorldPosition: double[3 1]
  WorldVelocity: double[3 1]
  EulerZYX: double[3 1]
  BodyAngularRateRPY: double[3 1]
  Thrust: double

MultirotorGuidanceControlBus = Simulink.Bus()
  Height: double
  AirSpeed: double
  RollAngle: double

MultirotorGuidanceEnvironmentBus = Simulink.Bus()
  WindNorth: double
  WindEast: double
  WindDown: double
  Gravity: double

FixedWingGuidanceStateBus = Simulink.Bus()
  North: double
  East: double
  Height: double
  AirSpeed: double
  HeadingAngle: double
  FlightPathAngle: double
  RollAngle: double
  RollAngleRate: double

FixedWingGuidanceControlBus = Simulink.Bus()
  Height: double
  AirSpeed: double
  RollAngle: double

FixedWingGuidanceEnvironmentBus = Simulink.Bus()
  WindNorth: double
  WindEast: double
  WindDown: double
  Gravity: double